# Grasshopper definition parabola_project.gh (Grasshopper 1.0.7)

arcs = Slider(6, range=0..10)
length = Slider(76, range=0..100)
scale = Slider(10, range=0..10)
width = Slider(53, range=0..100)
c_script = CSharpScript(x=scale)  # -> out, A, B; inputs x: Double
# ---------- c_script: C# ----------
    A = -Math.Abs(x);
    B = 2 * (Math.Abs(x)) + 1;
# ---------- end c_script ----------
series = Series(Start=c_script.A, Step=1, Count=c_script.B)
sqr = Square(Value=series)
series_2 = Series(Start=sqr, Step=1, Count=10)
multiplication = Multiplication(A=series, B=length)
item = ListItem(List=series_2, Index=0, Wrap=True)
path_mapper = PathMapper(item, source="{A;B;C}", target="{A;B}")
pt = ConstructPoint(XCoordinate=multiplication, YCoordinate=path_mapper, ZCoordinate=0)
lng = ListLength(List=pt)
subtraction = Subtraction(A=lng, B=1)
item_2 = ListItem(List=pt, Index=subtraction, Wrap=True)
item_3 = ListItem(List=pt, Index=0, Wrap=True)
intcrv = Interpolate(Vertices=pt, Degree=3, Periodic=False, KnotStyle=1)  # -> Curve, Length, Domain
Y = UnitY(Factor=width)
ln = Line(StartPoint=item_3, EndPoint=item_2)
move = Move(Geometry=ln, Motion=Y)  # -> Geometry, Transform
revsrf = Revolution(Curve=intcrv.Curve, Axis=move.Geometry, Domain=Domain(3.141592654, 0))
divide = DivideDomain²(Domain=revsrf, UCount=1, VCount=arcs)
area = Area(Geometry=revsrf)  # -> Area, Centroid
subsrf = Isotrim(Surface=revsrf, Domain=divide)
brep_cp = BrepClosestPoint(Point=area.Centroid, Brep=revsrf)  # -> Point, Normal, Distance
edges = BrepEdges(Brep=subsrf)  # -> Naked, Interior, NonManifold
cull = CullPattern(List=edges.Naked, CullPattern=[True, True, False])
midpt = CurveMiddle(Curve=cull)
cull_i = CullIndex(List=flatten(midpt), Indices=0, Wrap=True)
dist = Distance(PointA=brep_cp.Point, PointB=cull_i)
lng_2 = ListLength(List=cull_i)
integer_division = IntegerDivision(A=lng_2, B=2)
subtraction_2 = Subtraction(A=integer_division, B=1)
dom = ConstructDomain(DomainStart=0, DomainEnd=subtraction_2)
addition = Addition(A=subtraction_2, B=1)
subset = SubList(List=dist, Domain=dom, Wrap=True)  # -> List, Index
dom_2 = ConstructDomain(DomainStart=addition, DomainEnd=lng_2)
subset_2 = SubList(List=dist, Domain=dom_2, Wrap=True)  # -> List, Index
rev = ReverseList(List=subset.List)
rev_2 = ReverseList(List=subset_2.List)
division = Division(A=[rev, rev_2], B=Slider(9, range=0..100))
cir = Circle(Plane=cull_i, Radius=division)
project = Project(Curve=cir, Brep=revsrf, Direction=Vector(0, 0, 1))  # -> flatten(Curve)
srfsplit = SurfaceSplit(Surface=revsrf, Curves=project)
curve = Text("Curve")
lng_3 = ListLength(List=srfsplit)
subtraction_3 = Subtraction(A=lng_3, B=1)
item_4 = ListItem(List=srfsplit, Index=subtraction_3, Wrap=True)
item_5 = ListItem(List=cull, Index=Slider(0, range=0..11), Wrap=True)
item_6 = ListItem(List=item_5, Index=Slider(0, range=0..11), Wrap=True)
Z = UnitZ(Factor=10)
srfsplit_2 = SurfaceSplit(Surface=item_4, Curves=flatten(item_6))
extr = Extrude(Base=item_4, Direction=Z)
Z_2 = UnitZ(Factor=1)
cls = Closed(Curve=project)  # -> Closed, Periodic
extr_2 = Extrude(Base=srfsplit_2, Direction=Z_2)
dispatch = Dispatch(List=project, DispatchPattern=cls.Closed)  # -> ListA, ListB
subset_3 = SubList(List=project, Domain=cls.Closed, Wrap=True)  # -> List, Index
divide_2 = DivideCurve(Curve=dispatch.ListB, Count=2, Kinks=False)  # -> Points, Tangents, Parameters
divide_3 = DivideCurve(Curve=dispatch.ListA, Count=3, Kinks=False)  # -> Points, Tangents, Parameters
divide_4 = DivideCurve(Curve=dispatch.ListB, Count=2, Kinks=False)  # -> Points, Tangents, Parameters
graft = GraftTree(Tree=divide_3.Points, IncludeEmptyLists=True, IncludeNullItems=True)
graft_2 = GraftTree(Tree=divide_4.Points, IncludeEmptyLists=True, IncludeNullItems=True)
shift = ShiftList(List=divide_3.Points, Shift=2, Wrap=True)
shift_2 = ShiftList(List=divide_4.Points, Shift=1, Wrap=True)
ln_2 = Line(StartPoint=divide_3.Points, EndPoint=shift)
ln_3 = Line(StartPoint=divide_4.Points, EndPoint=shift_2)
pipe = Pipe(Curve=ln_2, Radius=1, Caps=0)
pipe_2 = Pipe(Curve=ln_3, Radius=1, Caps=0)
panel = Panel(dispatch.ListB)
