# Grasshopper definition solar_path.gh (Grasshopper 1.0.7)

panel = Panel("Solar")
number_slider = Slider(10, range=0..10)
long = Slider(69.531, range=0..360)
asin = ArcSine()
panel_2 = Panel("Alt")
c_script = CSharpScript(LAT=Slider(167.233, range=0..360), LONG=long, NDY=number_slider)  # -> out, ALT, AZI, DEC_output; inputs LAT: Double, LONG: Double, Hour: Int32, NDY: Int32
# ---------- c_script: C# ----------
  double HRA = 15 * (Hour - 12);
  double DEC = 23.45 * Math.Sin((0.986) * (284 + NDY));


  ALT = Math.Asin(
  (Math.Sin(DEC) * Math.Sin(LAT)+ Math.Cos(DEC)*Math.Cos(LAT)*Math.Cos(HRA))
  );

  AZI = Math.Acos(
  (Math.Cos(LAT) * Math.Sin(DEC)-Math.Cos(DEC)*Math.Sin(LAT)*Math.Cos(HRA)/Math.Cos(LAT))
  );


  DEC_output = (DEC);
# ---------- end c_script ----------
cos = Cosine()
c_script_2 = CSharpScript(LAT=number_slider, LONG=number_slider, NDY=number_slider)  # -> ALT; inputs LAT: Double, LONG: Double, Hour: Int32, NDY: Int32
# ---------- c_script_2: C# ----------
  HRA = 15 * (Hour -12);
 
  ALT = Math.Acos(
  (Math.Cos(LAT) * Math.Sin(DEC)-Math.Cos(DEC)*Math.Sin(LAT)*Math.Cos(HRA)/Math.Cos(LAT))
  );
# ---------- c_script_2: C# additional code ----------
public void Runscript (int NDY) {double DEC = 23.45 * Math.Sin((0.986) * (284 + NDY));}
# ---------- end c_script_2 ----------
asin_2 = ArcSine(Value=c_script.AZI)
multiplication = Multiplication(A=c_script.AZI, B=57.3)
panel_3 = Panel(asin_2)
