# Grasshopper definition solar_path_main.gh (Grasshopper 1.0.7)

minutes = Slider(0, range=0..60)
C = Count(13)
C_2 = Count(13)
series = Series(Start=-90, Step=15, Count=C)
division = Division(A=minutes, B=60)
number_slider = Slider(52, range=0..90)
number_slider_2 = Slider(13, range=0..13)
neg = Negative(Value=number_slider)
series_2 = Series(Start=-90, Step=15, Count=number_slider_2)
list = ValueList({"Equinox": 0, "Summer Solstice": 23.45, "Winter Solstice": -23.45}, selected="Summer Solstice")
series_3 = Series(Start=neg, Step=number_slider, Count=number_slider_2)
series_4 = Series(Start=-23.5, Step=23.5, Count=3)
number_slider_3 = Slider(76, range=0..100)
c_script = CSharpScript(x=series_3)  # -> out, A; inputs x: Double
# ---------- c_script: C# ----------
    A = x * (Math.PI / 180);
# ---------- end c_script ----------
c_script_2 = CSharpScript(x=series_4)  # -> out, A; inputs x: Double; same code as c_script
c_script_3 = CSharpScript(x=Slider(-19, range=-90..90))  # -> out, A; inputs x: Double; same code as c_script
series_5 = Series(Start=0, Step=1, Count=10)
c_script_4 = CSharpScript(r=number_slider_3, HRA=c_script.A, LAT=c_script_3.A, DEC=c_script_2.A)  # -> out, rs, ds, ALT_values, dt, dh, rh; inputs r: Double, HRA: Double, LAT: Double, DEC: Double
# ---------- c_script_4: C# ----------
    /*Convert to degrees*/
    double cdg = (180 / Math.PI);


    //double ALT = (Math.Asin((Math.Sin(DEC) * Math.Sin(LAT)) + (Math.Cos(DEC) * Math.Cos(LAT) * Math.Cos(HRA))));
    double[] ALT = {
      90 - LAT + 23.45,
      90,
      90 - LAT - 23.45
      };



    List<double> ALT_list = new List<double>();
    ALT_list.Add(90 - LAT + 23.45);

    foreach (double i in ALT)
    {
      ALT_list.Add(i * 1);
    }
/*
    List<double> ALT_list_corrected = new List<double>();
    foreach (double i in ALT_list)
    {
      ALT_list_corrected.Add(i * 1);
      } */

    rs = r * Math.Cos(DEC) / (Math.Sin(ALT_list) + Math.Sin(DEC));
    ds = r * Math.Cos(LAT) / (Math.Sin(LAT) + Math.Sin(DEC));
    //ALT_values = ALT_list_corrected[0];
    dt = r * (Math.Tan(LAT));
    dh = r / (Math.Cos(LAT)) * Math.Tan(HRA);
    rh = r / (Math.Cos(LAT)) * Math.Sin(HRA);
# ---------- end c_script_4 ----------
cir = Circle(Plane=PlaneXY(0, 0, 0), Radius=number_slider_3)
cp = ControlPoints(Curve=cir)  # -> Points, Weights, Knots
item = ListItem(List=c_script_4.dt, Index=0, Wrap=True)
darc = DeconstructArc(Arc=cir)  # -> BasePlane, Radius, Angle
item_2 = ListItem(List=c_script_4.ds, Index=0, Wrap=True)
item_3 = ListItem(List=cp.Points, Index=4, Wrap=True)
item_4 = ListItem(List=cp.Points, Index=8, Wrap=True)
neg_2 = Negative(Value=item_2)
ln = Line(StartPoint=item_3, EndPoint=item_4)
panel = Panel(c_script_4.rs)
ext = ExtendCurve(Curve=ln, Type=0, Start=item_2, End=item_2)
pt = ConstructPoint(XCoordinate=darc.BasePlane, YCoordinate=neg_2, ZCoordinate=0)
Y = UnitY(Factor=item)
move = Move(Geometry=ext, Motion=Y)  # -> Geometry, Transform
circle = CircleCNR(Center=pt, Normal=Vector(0, 0, 1), Radius=c_script_4.rs)
vdisex = VectorDisplayEx(Colour=RGB(0, 0, 0), Width=2)
trim = TrimWithRegion(Curve=circle, Region=cir)  # -> Inside, Outside
item_5 = ListItem(List=trim.Inside, Index=0, Wrap=True)
