# Grasshopper definition solar_path_reset.gh (Grasshopper 1.0.7)

series = Series(Start=-23.5, Step=23.5, Count=3)
number_slider = Slider(100, range=0..100)
P = Plane(PlaneXY(0, 0, 0))
neg = Negative(Value=number_slider)
pt = ConstructPoint(XCoordinate=0, YCoordinate=number_slider, ZCoordinate=0)
c_script = CSharpScript(r=number_slider, LAT=Slider(-22, range=-90..90))  # -> out, dh, ds, dt, rh, rs, hours; inputs r: Double, LAT: Double
# ---------- c_script: C# ----------
    //Convert degree input to radians
    double cdr = (Math.PI / 180);

    //Create DEC list, add DEC values
    List<double> DEC = new List<double>();
    DEC.Add(-23.45);  /*December 22*/
    DEC.Add(-18.00);  /*November 11 & January 30*/
    DEC.Add(-09.00);  /*October 14 & February 27*/
    DEC.Add(0.00);    /*March 21 & September 23*/
    DEC.Add(09.00);   /*April 14 & August 28*/
    DEC.Add(18.00);   /*May 12 & August 1*/
    DEC.Add(23.45);   /*June 22*/



    //Create ALT list, add ALT values
    List<double> ALT = new List<double>();
    ALT.Add(90.00 - LAT - 23.45);
    ALT.Add(90.00 - LAT - 18.00);
    ALT.Add(90.00 - LAT - 09.00);
    ALT.Add(90.00);
    ALT.Add(90.00 - LAT + 09.00);
    ALT.Add(90.00 - LAT + 18.00);
    ALT.Add(90.00 - LAT + 23.45);


    //Create rs (radius of sun path arc) values
    //double rs1 = (r * Math.Cos(DEC[0] * cdr)) / (Math.Sin(LAT * cdr) + Math.Sin(DEC[0] * cdr));
    //double rs1 = (r * Math.Cos(DEC[0] * cdr)) / (Math.Sin(LAT * cdr) + Math.Sin(DEC[0] * cdr));
    //double rs2 = (r * Math.Cos(DEC[1] * cdr)) / (Math.Sin(LAT * cdr) + Math.Sin(DEC[1] * cdr));
    //double rs3 = (r * Math.Cos(DEC[2] * cdr)) / (Math.Sin(LAT * cdr) + Math.Sin(DEC[2] * cdr));
    //double rs1 = (r * Math.Cos(DEC[0] * cdr)) / (Math.Sin(LAT * cdr) + Math.Sin(DEC[0] * cdr));
    //double rs1 = (r * Math.Cos(DEC[0] * cdr)) / (Math.Sin(LAT * cdr) + Math.Sin(DEC[0] * cdr));


    //Add values to rs list
    List<double> rs_input = new List<double>();
    foreach (double d in DEC) {
      rs_input.Add((r * Math.Cos(d * cdr)) / (Math.Sin(LAT * cdr) + Math.Sin(d * cdr)));
    }

    //Create ds (distance of rs from centre) values
    double ds1 = (r * (Math.Cos(LAT * cdr))) / (Math.Sin(LAT * cdr) + Math.Sin(DEC[0] * cdr));
    double ds2 = (r * Math.Cos(LAT * cdr)) / (Math.Sin(LAT * cdr) + Math.Sin(DEC[1] * cdr));
    double ds3 = (r * (Math.Cos(LAT * cdr))) / (Math.Sin(LAT * cdr) + Math.Sin(DEC[2] * cdr));

    //Add values to ds list
    List<double> ds_input = new List<double>();
    foreach (double d in DEC) {
      ds_input.Add((r * (Math.Cos(LAT * cdr))) / (Math.Sin(LAT * cdr) + Math.Sin(d * cdr)));
    }

    //Create dt (distance of hour line from centre)
    double dt_input = (r * Math.Tan(LAT * cdr));

    //Create HRA (hour line) values
    List<int> HRA = new List<int>();
    int i = 15;
    for(i = -90; i <= 90; i += 15)
    {
      HRA.Add(i);
    }

    //Create dh ( hour line horiz. distance from vertical)
    List<double> dh_input = new List<double>();
    foreach (double hour in HRA)
    {
      {
        double dh_values = r / (Math.Cos(LAT * cdr) * Math.Tan(hour * cdr));
        dh_input.Add(dh_values);
      }
    }

    //dh_input.Remove(double.PositiveInfinity);
    //dh_input.Add(0);
    //dh_input.Sort();

    //Create rh (radius of hour line)
    List<double> rh_input = new List<double>();
    foreach (double hour in HRA)
    {
      double rh_values = r / ((Math.Cos(LAT * cdr)) * (Math.Sin(hour * cdr)));
      rh_input.Add(rh_values);
    }

    //rh_input.Remove(double.PositiveInfinity);
    //rh_input.Sort();


    ds = ds_input;
    rs = rs_input;
    dh = dh_input;
    rh = rh_input;
    dt = dt_input;
    hours = HRA;
# ---------- end c_script ----------
pt_2 = ConstructPoint(XCoordinate=0, YCoordinate=neg, ZCoordinate=0)
ln = Line(StartPoint=pt, EndPoint=pt_2)
c_script_2 = CSharpScript(x=c_script.hours)  # -> out, A; inputs x: Double
# ---------- c_script_2: C# ----------
    A = 100 / (Math.Cos(-28 * (Math.PI/180)) * Math.Tan(x * (Math.PI/180)));
# ---------- end c_script_2 ----------
Y = UnitY(Factor=c_script.ds)
base_circle = Circle(Plane=P, Radius=number_slider)
circle = CircleCNR(Center=P, Normal=Vector(0, 0, 1), Radius=c_script.rs)
len = Length(Curve=base_circle)
pt_3 = ConstructPoint(XCoordinate=c_script.dh, YCoordinate=0, ZCoordinate=0)
Y_2 = UnitY(Factor=c_script.dt)
dec_lines = Move(Geometry=circle, Motion=Y)  # -> Geometry, Transform
division = Division(A=len, B=360)
neg_2 = Negative(Value=c_script.dt)
panel = Panel(c_script.hours)
move = Move(Geometry=pt_3, Motion=Y_2)  # -> Geometry, Transform
divlength = DivideLength(Curve=base_circle, Length=division)  # -> Points, Tangents, Parameters
Y_3 = UnitY(Factor=neg_2)
ccx = CurveCurve(CurveA=base_circle, CurveB=dec_lines.Geometry)  # -> Points, ParamsA, ParamsB
circle_2 = CircleCNR(Center=move.Geometry, Normal=Vector(0, 0, 1), Radius=c_script.rh)
multiplication = Multiplication(A=Y_3, B=2)
shatter = Shatter(Curve=graft(dec_lines.Geometry), Parameters=ccx.ParamsB)
item = ListItem(List=divlength.Points, Index=Slider(116, range=0..360), Wrap=True)
hr_lines = Move(Geometry=circle_2, Motion=multiplication)  # -> Geometry, Transform
B = EndPoint(Point(0, 0, 0))
item_2 = ListItem(List=shatter, Index=0, Wrap=True)
bbx = BrepBrep(BrepA=base_circle, BrepB=hr_lines.Geometry)  # -> Curves, Points
ln_2 = Line(StartPoint=item, EndPoint=B)
ccx_2 = CurveCurve(CurveA=base_circle, CurveB=item_2)  # -> Points, ParamsA, ParamsB
devec = DeconstructVector(Vector=bbx.Curves)  # -> XComponent, YComponent, ZComponent
ccx_3 = CurveCurve(CurveA=item_2, CurveB=graft(bbx.Curves))  # -> Points, ParamsA, ParamsB
panel_2 = Panel(hr_lines.Geometry)
item_3 = ListItem(List=flatten(ccx_2.Points), Index=0, Wrap=True)
tag = TextTag(Location=item_3, Text="January")
panel_3 = Panel(devec.ZComponent)
ccx_4 = CurveCurve()  # -> Points, ParamsA, ParamsB
shatter_2 = Shatter(Parameters=ccx_4.Points)
